# Grasshopper definition LAC_KarambaTest.gh (Grasshopper 1.0.7)
# plug-ins: LCA_DEV, Karamba3D, CORE.Grasshopper.Colibri, myGHToolbox

material_selection_karamba3d = MaterialSelectionKaramba3D(menu=[dropdown(1), dropdown(4)])
material_selection_karamba3d_2 = MaterialSelectionKaramba3D(menu=[dropdown(2), dropdown(1)])
point_anchor = Point([Point(5000, 0, 0), Point(0, 0, 0)])
lac_construct_material_from_materialpyra = LACConstructMaterialFromMaterialpyramidenDk(menu=[dropdown(4), dropdown(8)])
lac_construct_material_from_materialpyra_2 = LACConstructMaterialFromMaterialpyramidenDk(menu=[dropdown(1), dropdown(4)])
disassemble_material_karamba3d = DisassembleMaterialKaramba3D(Material=material_selection_karamba3d)  # -> Material, TypeOfMaterial, FamilyNameOfMaterial, NameOfMaterial, ElemIdentifiers, Color, YoungsModulusKNCm2Dir12, InPlaneShearModulus_kN_cm2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
disassemble_material_karamba3d_2 = DisassembleMaterialKaramba3D(Material=material_selection_karamba3d_2)  # -> Material, TypeOfMaterial, FamilyNameOfMaterial, NameOfMaterial, ElemIdentifiers, Color, YoungsModulusKNCm2Dir12, InPlaneShearModulus_kN_cm2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
list_item = ListItem(List=point_anchor, Index=0, Wrap=True)  # -> Item, Item1
line = Line(StartPoint=list_item.Item, EndPoint=list_item.Item1)
panel = Panel(disassemble_material_karamba3d.NameOfMaterial)
panel_2 = Panel(disassemble_material_karamba3d_2.NameOfMaterial)
divide_curve = DivideCurve(Curve=line, Count=Slider(3, range=2..10), Kinks=False)  # -> Points, Tangents, Parameters
lca_material = LCAMaterial(Material=lac_construct_material_from_materialpyra_2, Description=panel)  # -> Material, Name, Category, Description, Density_kg_m3, Insulation_W_m2_K, GWPKgCO2eqM3A1A3, ODP_R11_eq_m3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
lca_material_2 = LCAMaterial(Material=lac_construct_material_from_materialpyra, Description=panel_2)  # -> Material, Name, Category, Description, Density_kg_m3, Insulation_W_m2_K, GWPKgCO2eqM3A1A3, ODP_R11_eq_m3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
polyline = PolyLine(Vertices=divide_curve.Points, Closed=False)
explode = Explode(Curve=polyline, Recursive=True)  # -> Segments, Vertices
unit_z = UnitZ(Factor=Slider(1162, range=1000..5000))
curve_middle = CurveMiddle(Curve=explode.Segments)
move = Move(Geometry=curve_middle, Motion=unit_z)  # -> Geometry, Transform
panel_3 = Panel([lca_material_2.Name, lca_material_2.Description])
panel_4 = Panel([lca_material.Name, lca_material.Description])
weave = Weave(Pattern=[0, 1], Stream0=divide_curve.Points, Stream1=move.Geometry, NullGaps=False)
polyline_2 = PolyLine(Vertices=move.Geometry, Closed=False)
polyline_3 = PolyLine(Vertices=weave, Closed=False)
explode_2 = Explode(Curve=polyline_3, Recursive=True)  # -> flatten(Segments), Vertices
explode_3 = Explode(Curve=explode_2.Segments, Recursive=True)  # -> flatten(Segments), Vertices
explode_4 = Explode(Curve=polyline, Recursive=True)  # -> flatten(Segments), Vertices
intergerpermutations = IntergerPermutations(InputList=[lca_material_2.Material, lca_material.Material], Length="3", AlowRepetitions=True)
lca_material_3 = LCAMaterial(Material=intergerpermutations)  # -> Material, Name, Category, Description, Density_kg_m3, Insulation_W_m2_K, GWPKgCO2eqM3A1A3, ODP_R11_eq_m3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
divide_curve_2 = DivideCurve(Curve=reparameterize(explode_3.Segments), Count=Slider(4, range=0..10), Kinks=False)  # -> Points, Tangents, Parameters
explode_5 = Explode(Curve=polyline_2, Recursive=True)  # -> flatten(Segments), Vertices
divide_curve_3 = DivideCurve(Curve=reparameterize(explode_4.Segments), Count=Slider(1, range=0..10), Kinks=False)  # -> Points, Tangents, Parameters
divide_curve_4 = DivideCurve(Curve=reparameterize(explode_5.Segments), Count=Slider(4, range=0..10), Kinks=False)  # -> Points, Tangents, Parameters
panel_5 = Panel("""Upper
Mid
Lower""")
panel_6 = Panel(lca_material_3.Name)
explode_6 = Explode(Curve=explode_2.Segments, Recursive=True)  # -> flatten(Segments), Vertices
shatter = Shatter(Curve=reparameterize(graft(explode_2.Segments)), Parameters=divide_curve_2.Parameters)  # -> flatten(Segments)
list_item_2 = ListItem(List=panel_5, Index=0, Wrap=True)  # -> Item, Item1, Item2
shatter_2 = Shatter(Curve=reparameterize(graft(explode_4.Segments)), Parameters=divide_curve_3.Parameters)  # -> flatten(Segments)
shatter_3 = Shatter(Curve=reparameterize(graft(explode_5.Segments)), Parameters=divide_curve_4.Parameters)  # -> flatten(Segments)
tree_statistics = TreeStatistics(Tree=intergerpermutations)  # -> Paths, Length, Count
remove_duplicate_points_karamba3d = RemoveDuplicatePointsKaramba3D(Point=flatten(divide_curve_3.Points), LimitDistance=0.005)  # -> OutPoint, Info, Indexes
list_item_3 = ListItem(List=point_anchor, Index=0, Wrap=True)  # -> Item, Item1
panel_7 = Panel(list_item_2.Item)
permutationid = Panel(tree_statistics.Paths)
panel_8 = Panel(list_item_2.Item1)
panel_9 = Panel(list_item_2.Item2)
line_to_beam_karamba3d = LineToBeamKaramba3D(
    Line=explode_5.Segments,
    Identifier=panel_7,
    New=True,
    Remove=True,
    LimitDistance_m=0.005,
    Bending=True,
    SetBucklingLength=True,
    ToPolylineMaxAngle=0.03,
    ToPolylineTolerance=0.01,
    ToPolylineMaxEdgeLength=0.25)  # -> Element, Points, Info
line_to_beam_karamba3d_2 = LineToBeamKaramba3D(
    Line=explode_2.Segments,
    Identifier=panel_8,
    New=True,
    Remove=True,
    LimitDistance_m=0.005,
    Bending=True,
    SetBucklingLength=True,
    ToPolylineMaxAngle=0.03,
    ToPolylineTolerance=0.01,
    ToPolylineMaxEdgeLength=0.25)  # -> Element, Points, Info
support_karamba3d = SupportKaramba3D(PosInd=list_item_3.Item, menu=[buttons(on, on, on, on, off, on)])
support_karamba3d_2 = SupportKaramba3D(PosInd=list_item_3.Item1, menu=[buttons(off, on, on, on, off, on)])
colibri_inputs_iterator = ColibriInputsIterator(PermutationID=permutationid, ignoreAllWarningMsg=False)  # -> UniqueName, Inputs, PermutationID
list_item_4 = ListItem(List=panel_5, Index=0, Wrap=True)  # -> Item, Item1, Item2
loads_karamba3d = LoadsKaramba3D(ForceVector="0,0,-300", Local=False, PosInd=remove_duplicate_points_karamba3d.OutPoint, LCase="0", mode="Point")
loads_karamba3d_2 = LoadsKaramba3D(Vector=Vector(0, 0, -1), LCase="0", mode="Gravity")
panel_10 = Panel(colibri_inputs_iterator.PermutationID)
line_to_beam_karamba3d_3 = LineToBeamKaramba3D(
    Line=flatten(explode_4.Segments),
    Identifier=panel_9,
    New=True,
    Remove=True,
    LimitDistance_m=0.005,
    Bending=True,
    SetBucklingLength=True,
    ToPolylineMaxAngle=0.03,
    ToPolylineTolerance=0.01,
    ToPolylineMaxEdgeLength=0.25)  # -> Element, Points, Info
tree_branch = TreeBranch(Tree=intergerpermutations, Path="{0;0}", MaintainPaths=True)
lca_material_4 = LCAMaterial(Material=tree_branch)  # -> Material, Name, Category, Description, Density_kg_m3, Insulation_W_m2_K, GWPKgCO2eqM3A1A3, ODP_R11_eq_m3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
panel_11 = Panel(lca_material_4.Name)
list_item_5 = ListItem(List=lca_material_4.Description, Index=0, Wrap=True)  # -> Item, Item1, Item2
material_selection_karamba3d_3 = MaterialSelectionKaramba3D(NameOrListIndexOfMaterial=list_item_5.Item, menu=[dropdown(1), dropdown(0)])
material_selection_karamba3d_4 = MaterialSelectionKaramba3D(NameOrListIndexOfMaterial=list_item_5.Item1, menu=[dropdown(1), dropdown(1)])
material_selection_karamba3d_5 = MaterialSelectionKaramba3D(NameOrListIndexOfMaterial=list_item_5.Item2, menu=[dropdown(1), dropdown(0)])
range = Range(Domain="1 to 50", Steps="100")
integer = Integer(range)
cross_section_karamba3d = CrossSectionKaramba3D(
    FamilyNameOfCrossSection="DefaultCroSec",
    ElementIdentifier=list_item_4.Item1,
    Material=flatten(material_selection_karamba3d_4),
    Height_cm=integer,
    UpperFlangeWidth_cm=integer,
    LowerFlangeWidth_cm=integer,
    mode="Trapezoid")
cross_section_karamba3d_2 = CrossSectionKaramba3D(
    FamilyNameOfCrossSection="DefaultCroSec",
    ElementIdentifier=list_item_4.Item,
    Material=flatten(material_selection_karamba3d_3),
    Height_cm=integer,
    UpperFlangeWidth_cm=integer,
    LowerFlangeWidth_cm=integer,
    mode="Trapezoid")
cross_section_karamba3d_3 = CrossSectionKaramba3D(
    FamilyNameOfCrossSection="DefaultCroSec",
    ElementIdentifier=list_item_4.Item2,
    Material=flatten(material_selection_karamba3d_5),
    Height_cm=integer,
    UpperFlangeWidth_cm=integer,
    LowerFlangeWidth_cm=integer,
    mode="Trapezoid")
list_item_6 = ListItem(List=cross_section_karamba3d_3, Index=0, Wrap=True)
merge = Merge(Data1=loads_karamba3d_2, Data2=loads_karamba3d)  # -> flatten(Result)
merge_2 = Merge(Data1=line_to_beam_karamba3d.Element, Data2=line_to_beam_karamba3d_2.Element, Data3=line_to_beam_karamba3d_3.Element)  # -> flatten(Result)
merge_3 = Merge(Data1=support_karamba3d, Data2=support_karamba3d_2)  # -> flatten(Result)
assemble_model_karamba3d = AssembleModelKaramba3D(Elem=merge_2, Support=merge_3, Load=merge, CrossSection=list_item_6, LimitDistance_m=0.005)  # -> Model, Info, Mass_kg, CenterOfGravity, LoadCaseNames
merge_4 = Merge(Data1=cross_section_karamba3d_2, Data2=cross_section_karamba3d, Data3=cross_section_karamba3d_3)  # -> flatten(Result)
analyze_karamba3d = AnalyzeKaramba3D(Model=assemble_model_karamba3d.Model)  # -> CalculatedModel, MaximumDisplacement_cm, ResultingForceOfGravity_kN, ElasticEnergyChange_kNm
panel_12 = Panel("Concrete C30/37")
optimize_cross_section_karamba3d = OptimizeCrossSectionKaramba3D(
    Model=assemble_model_karamba3d.Model,
    CrossSections=merge_4,
    MaximumUtilization=Slider(0.6, range=0..7),
    UltimateLimitStateIterations=5,
    DisplacementIterations=5,
    NumberOfSamplePoints=3,
    ElasticDesign=True,
    GammaM0=1,
    GammaM1=1.1,
    SwayFrame=True)  # -> ModelWithOptimizedCrossSections, Info, Mass_kg, MaximumDisplacement_cm, ElasticEnergyChange_kNm
panel_13 = Panel(optimize_cross_section_karamba3d.Info)
material_selection_karamba3d_6 = MaterialSelectionKaramba3D(menu=[dropdown(1), dropdown(4)])
settings_karamba3d = SettingsKaramba3D(menu=[dropdown(2)])  # -> AllSettings, GenericOutput
model_view_karamba3d = ModelViewKaramba3D(Model=optimize_cross_section_karamba3d.ModelWithOptimizedCrossSections, ResultFactors=1, ResultCase=-1)  # -> Model, DeformedMesh, DeformedAxes, DeformedModel
lca_material_5 = LCAMaterial(Material=tree_branch)  # -> Material, Name, Category, Description, Density_kg_m3, Insulation_W_m2_K, GWPKgCO2eqM3A1A3, ODP_R11_eq_m3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
beam_view_karamba3d = BeamViewKaramba3D(Model=model_view_karamba3d.Model)  # -> Model, MeshesOfRenderedBeams, DeformedBeamAxes, LegendColors, LegendTags
list_item_7 = ListItem(List=lca_material_5.Description, Index=0, Wrap=True)  # -> Item, Item1, Item2
element_query_karamba3d = ElementQueryKaramba3D(Model=beam_view_karamba3d.Model, ElementsIdentifiers=graft(panel_5))  # -> Model, Mass_kg, Area_m2, Volume_m3, Meshes
concatenate = Concatenate(Fragment_A=list_item_7.Item, Fragment_B=list_item_7.Item1, A=list_item_7.Item2, JoinSeparator="-")
panel_14 = Panel("C:\Users\frans\OneDrive\Dev_OneDrive\Rhino\GH_LCA\RhinoFiles\KarmabaTest\Output")
replace_text = ReplaceText(Text=concatenate, Find="/", Replace="_", RecursiveReplace=False)
mass_addition = MassAddition(Input=element_query_karamba3d.Volume_m3)  # -> Result, PartialResults
lca_create_element_from_volume = LCACreateElementFromVolume(
    Material=graft(lca_material_4.Material),
    Volume_m3=mass_addition.Result,
    ExpectedLifetime_years=-1,
    ElementName=graft(panel_5))  # -> Element, Weight_kg, GWPKgCO2eqM3A1A3
colibri_image_setting = ColibriImageSetting(ImageSaveAsName=replace_text, RhinoViewNames="Front", Width=600, Height=600)
panel_15 = Panel(element_query_karamba3d.Mass_kg)
mass_addition_2 = MassAddition(Input=flatten(element_query_karamba3d.Mass_kg))  # -> Result, PartialResults
select_elements_karamba3d = SelectElementsKaramba3D(Model=beam_view_karamba3d.Model, ElementIdentifiers=panel_5)  # -> Model, Elements
mass_addition_3 = MassAddition(Input=flatten(lca_create_element_from_volume.Weight_kg))  # -> Weight_kg, PartialResults
disassemble_element_karamba3d = DisassembleElementKaramba3D(Element=select_elements_karamba3d.Elements)  # -> Element, ElementIdentifier, AxisOfElement, CrossSection, Joint, Material, LocalCoordinateSystem, ElementIsActive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
mass_addition_4 = MassAddition(Input=flatten(lca_create_element_from_volume.GWPKgCO2eqM3A1A3))  # -> GWPKgCO2eqM3A1A3, PartialResults
panel_16 = Panel(lca_create_element_from_volume.GWPKgCO2eqM3A1A3)

# ----
# CHECK UNITS OF VOLUME CALULATION ?
panel_17 = Panel(mass_addition_2.Result)
panel_18 = Panel(lca_create_element_from_volume.Weight_kg)

panel_19 = Panel(disassemble_element_karamba3d.Material)
colibri_outputs = ColibriOutputs(
    Materials=flatten(replace_text),
    GWP_kg_CO2eq_m3_A1_A3=flatten(mass_addition_4.GWPKgCO2eqM3A1A3),
    Weight_kg=flatten(mass_addition_3.Weight_kg),
    Info=flatten(optimize_cross_section_karamba3d.Info),
    Mass_kg=flatten(optimize_cross_section_karamba3d.Mass_kg))
colibri_aggregator = ColibriAggregator(
    Folder=panel_14,
    Inputs=colibri_inputs_iterator.Inputs,
    Outputs=colibri_outputs,
    ImageSetting=colibri_image_setting,
    Write=Toggle(False),
    recordingMode=3)
