# Grasshopper definition test01.gh (Grasshopper 1.0.7)
# plug-ins: GH_LCA

material_name = ValueList({"Reused brick", "Plywood", "Aluminium sheet", "Lime sandstone", "Concrete C20/25", "Concrete C30/37", "Straw"}, selected="Straw")
material_name_2 = ValueList({"Reused brick", "Plywood", "Aluminium sheet", "Lime sandstone", "Concrete C20/25", "Concrete C30/37", "Straw"}, selected="Lime sandstone")
lac_select_material = LACSelectMaterial(MaterialName=material_name)  # -> Material, Name, Density_kg_m3, GWP_kg_CO2eq_m3, DebugSting
lac_select_material_2 = LACSelectMaterial(MaterialName=material_name_2)  # -> Material, Name, Density_kg_m3, GWP_kg_CO2eq_m3, DebugSting
panel = Panel(lac_select_material.GWP_kg_CO2eq_m3)
panel_2 = Panel(lac_select_material.Density_kg_m3)
panel_3 = Panel(lac_select_material.Name)
domain_box = DomainBox(Base=PlaneXY(0, 0, 0), X=Slider(8, range=0..10), Y=Domain(-0.5, 0.5), Z=Domain(0, 0.25))
curve = Curve(<curve referenced from the Rhino model>)
lca_create_element_from_curve = LCACreateElementFromCurve(
    Curve=curve,
    Material=lac_select_material_2.Material,
    CrossSectionDimentionX=0,
    CrossSectionDimentionY=0,
    CrossSectionArea="1")  # -> Element, Volume_m3, Weight_kg, GWP_kg_CO2eq
lca_create_element_from_solid = LCACreateElementFromSolid(Geometry=domain_box, Material=lac_select_material.Material)  # -> Element, Volume_m3, Weight_kg, GWP_kg_CO2eq
panel_4 = Panel("2")
lca_calculate_model = LCACalculateModel(Elements=[lca_create_element_from_solid.Element, lca_create_element_from_curve.Element])  # -> CalculatedModel, GWPKgCO2eqTotal, SUMGWP_kg_CO2eq, ListGWPKgCO2eqByMaterial, ListGWPByMaterial, SUMWeight_kg, ListWeightKgByMaterial, ListWeightByMaterial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
panel_5 = Panel(lca_calculate_model.CalculatedModel)
panel_6 = Panel(lca_calculate_model.GWPKgCO2eqTotal)
panel_7 = Panel(lca_calculate_model.SUMGWP_kg_CO2eq)
panel_8 = Panel(lca_calculate_model.SUMWeight_kg)
panel_9 = Panel(lca_calculate_model.SUMVolume_m3)
