# Grasshopper definition DevDebug.gh (Grasshopper 1.0.7)
# plug-ins: LCA_Toolbox, LunchBox

lac_get_material_from_materialpyramiden = LACGetMaterialFromMaterialpyramidenDk(dropvariable_category="trae", dropvariable_material="Oak tree", menu=[dropdown(4), dropdown(0)])
lac_get_material_from_materialpyramiden_2 = LACGetMaterialFromMaterialpyramidenDk(dropvariable_category="mineralsk", dropvariable_material="Concrete C20/25", menu=[dropdown(3), dropdown(0)])
number_slider = Slider(5000, range=0..10000)
number_slider_2 = Slider(3, range=0..10)
lca_material = LCAMaterial(Material=lac_get_material_from_materialpyramiden_2)  # -> Material, MaterialName, Category, Description, Density_kg_m3, Insulation_W_m2_K, A1A3ProductStage_kg_CO2eq_m3, ODP_R11_eq_m3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
square_root = SquareRoot(Value="10*1e6")
lca_material_2 = LCAMaterial(
    Material=lac_get_material_from_materialpyramiden,
    Density_kg_m3=Slider(1, range=0..1),
    A1A3ProductStage_kg_CO2eq_m3="100",
    C1C4EndOfLife_kg_CO2eq_m3="12")  # -> Material, MaterialName, Category, Description, Density_kg_m3, Insulation_W_m2_K, A1A3ProductStage_kg_CO2eq_m3, ODP_R11_eq_m3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
series = Series(Start="200", Step="200", Count=number_slider_2)
series_2 = Series(Start=0, Step=Slider(1000, range=0..1000), Count=number_slider_2)
rectangle = Rectangle(Plane=PlaneXY(0, 0, 0), XSize=square_root, YSize=square_root, Radius=0)  # -> Rectangle, Length
unit_z = UnitZ(Factor=series_2)
box_rectangle = BoxRectangle(Rectangle=rectangle.Rectangle, Height=series)
move = Move(Geometry=box_rectangle, Motion=unit_z)  # -> Geometry, Transform
lca_element_from_solid = LCAElementFromSolid(SolidGeomerty=move.Geometry, Material=lca_material.Material, ExpectedLifetime_years="2")  # -> Element, Volume_m3, Weight_kg, A1A3ProductStage_kg_CO2eq_element; disabled
lca_element_from_solid_2 = LCAElementFromSolid(
    SolidGeomerty=move.Geometry,
    Material=lca_material_2.Material,
    ExpectedLifetime_years="30",
    A4TransportationToSite_kg_CO2eq_kg="30")  # -> Element, Volume_m3, Weight_kg, A1A3ProductStage_kg_CO2eq_element; disabled
lca_element_from_solid_3 = LCAElementFromSolid(SolidGeomerty=move.Geometry, Material=lca_material.Material, ExpectedLifetime_years="10")  # -> Element, Volume_m3, Weight_kg, A1A3ProductStage_kg_CO2eq_element
number_slider_3 = Slider(60, range=1..100)
kwh_year = Panel("-10e3 to -300e3")
el_mix_co2eq_kwh = Panel("0.25 to  0.0013")
number_slider_4 = Slider(60, range=1..100)
duplicate_data = DuplicateData(Data=lca_element_from_solid_3.Element, Number=Slider(1, range=0..110), Order=True)
range = Range(Domain=kwh_year, Steps=number_slider_3)
range_2 = Range(Domain=el_mix_co2eq_kwh, Steps=number_slider_3)
addition = Addition(A=range, B="20e3")
multiplication = Multiplication(A=addition, B=range_2)
lca_assemble_model = LCAAssembleModel(
    Elements=flatten([duplicate_data, lca_element_from_solid.Element, lca_element_from_solid_2.Element]),
    B6OperationalEnergy_kg_CO2eq_year=multiplication,
    ExpectedLifetime_years=number_slider_4,
    AllowCarbonSequestration=False)  # -> Model, GWPTotal_kg_CO2eq
division = Division(A=lca_assemble_model.GWPTotal_kg_CO2eq, B="1e3")
colour_swatch = ColourSwatch(SwatchColor=RGB(26, 240, 73))
colour_swatch_2 = ColourSwatch(SwatchColor=RGB(255, 0, 0))
division_2 = Division(A=division, B=number_slider_4)
panel = Panel(division_2)
lca_result_viewer = LCAResultViewer(Model=lca_assemble_model.Model, NormalizeValues=False, ColorMin=RGB(255, 255, 255), ColorMax=RGB(255, 0, 0))  # -> Geo, ResultColour
lca_result_simple = LCAResultSimple(Model=lca_assemble_model.Model, AllowCarbonSequestration=Toggle(False))  # -> EmbodiedCarbon_kg_CO2eq, OperationalCarbon_kg_CO2eq, GWPTotal_kg_CO2eq
lca_result_timeline = LCAResultTimeline(Model=lca_assemble_model.Model, AllowCarbonSequestration=False)  # -> DataGridHeaders, ValueTree_
create_material = CreateMaterial(Diffuse=RGB(255, 105, 180), Specular=RGB(255, 255, 255), Emission=RGB(0, 0, 0), Transparency=0, Shine=0)
custom_preview = CustomPreview(Material=create_material)
integer = Integer([lca_result_simple.EmbodiedCarbon_kg_CO2eq, lca_result_simple.OperationalCarbon_kg_CO2eq, lca_result_simple.GWPTotal_kg_CO2eq])
panel_2 = Panel(integer)
panel_3 = Panel(lca_result_timeline.DataGridHeaders)
division_3 = Division(A=lca_result_timeline.ValueTree_, B=Slider(1000, range=0..1000))
flip_matrix = FlipMatrix(Data=lca_result_timeline.ValueTree_)
create_csv = CreateCSV(DataGridHeaders=lca_result_timeline.DataGridHeaders, ValueTree=flip_matrix, Delimiter=",")
panel_4 = Panel(create_csv)
