# Grasshopper definition DevDebug0_1_3.gh (Grasshopper 1.0.7)
# plug-ins: LCA_Toolbox, LunchBox

lac_get_material_from_materialpyramiden = LACGetMaterialFromMaterialpyramidenDk(dropvariable_category="--ALL--", dropvariable_material="XPS insulation", menu=[dropdown(0), dropdown(61)])
lca_material = LCAMaterial(Material=lac_get_material_from_materialpyramiden)  # -> Material, MaterialName, Category, Description, Density_kg_m3, Insulation_W_m2_K, A1A3ProductStage_kg_CO2eq_m3, ODP_R11_eq_m3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
number_slider = Slider(1000, range=0..1000)
number_slider_2 = Slider(1000, range=0..1000)
division = Division(A=lca_material.A1A3ProductStage_kg_CO2eq_m3, B=2)
point = Point(Point(2967.944009, 793.6730481, 0))
lca_material_2 = LCAMaterial(Material=lac_get_material_from_materialpyramiden, C1C4EndOfLife_kg_CO2eq_m3=division)  # -> Material, MaterialName, Category, Description, Density_kg_m3, Insulation_W_m2_K, A1A3ProductStage_kg_CO2eq_m3, ODP_R11_eq_m3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
rectangle = Rectangle(Plane=point, XSize=number_slider_2, YSize=number_slider_2, Radius=0)  # -> Rectangle, Length
rectangle_2 = Rectangle(Plane=PlaneXY(0, 0, 0), XSize=number_slider, YSize=number_slider, Radius=0)  # -> Rectangle, Length
box_rectangle = BoxRectangle(Rectangle=rectangle.Rectangle, Height=number_slider_2)
box_rectangle_2 = BoxRectangle(Rectangle=rectangle_2.Rectangle, Height=number_slider)
lca_element_from_solid = LCAElementFromSolid(
    SolidGeomerty=box_rectangle_2,
    Material=lca_material_2.Material,
    ExpectedLifetime_years=-1,
    A4TransportationToSite_kg_CO2eq_kg="0")  # -> Element, Volume_m3, Weight_kg, A1A3ProductStage_kg_CO2eq_element
lca_element_from_solid_2 = LCAElementFromSolid(
    SolidGeomerty=box_rectangle,
    Material=lca_material_2.Material,
    ExpectedLifetime_years=-1,
    A4TransportationToSite_kg_CO2eq_kg="0")  # -> Element, Volume_m3, Weight_kg, A1A3ProductStage_kg_CO2eq_element
lca_element_from_solid_3 = LCAElementFromSolid(ExpectedLifetime_years=-1)  # -> Element, Volume_m3, Weight_kg, A1A3ProductStage_kg_CO2eq_element
lca_element_from_curve = LCAElementFromCurve(ExpectedLifetime_years=-1)  # -> Element, Volume_m3, Weight_kg, A1A3ProductStage_kg_CO2eq_element
lca_element_from_shell = LCAElementFromShell(ExpectedLifetime_years=-1)  # -> Element, Volume_m3, Weight_kg, A1A3ProductStage_kg_CO2eq_element
lca_element_from_volume = LCAElementFromVolume(ExpectedLifetime_years=-1)  # -> Element, Weight_kg, A1A3ProductStage_kg_CO2eq_element
boolean_toggle = BooleanToggle(False)
number_slider_3 = Slider(10, range=0..10)
lca_assemble_model = LCAAssembleModel(
    Elements=flatten([lca_element_from_solid.Element, lca_element_from_solid_2.Element]),
    B6OperationalEnergy_kg_CO2eq_year="100",
    ExpectedLifetime_years=60,
    AllowCarbonSequestration=boolean_toggle)  # -> Model, GWPTotal_kg_CO2eq
lca_result_simple = LCAResultSimple(Model=lca_assemble_model.Model, AllowCarbonSequestration=boolean_toggle)  # -> EmbodiedCarbon_kg_CO2eq, OperationalCarbon_kg_CO2eq, GWPTotal_kg_CO2eq
lca_result_timeline = LCAResultTimeline(Model=lca_assemble_model.Model, AllowCarbonSequestration=boolean_toggle)  # -> DataGridHeaders, ValueTree_
lca_result_viewer = LCAResultViewer(Model=lca_assemble_model.Model, NormalizeValues=False, ColorMin=RGB(255, 255, 255), ColorMax=RGB(255, 0, 0))  # -> Geo, ResultColour
flip_matrix = FlipMatrix(Data=lca_result_timeline.ValueTree_)
create_material = CreateMaterial(Diffuse=lca_result_viewer.ResultColour, Specular=RGB(255, 255, 255), Emission=RGB(0, 0, 0), Transparency=0, Shine=0)
panel = Panel([lca_result_simple.EmbodiedCarbon_kg_CO2eq, lca_result_simple.OperationalCarbon_kg_CO2eq, lca_result_simple.GWPTotal_kg_CO2eq])
create_csv = CreateCSV(DataGridHeaders=lca_result_timeline.DataGridHeaders, ValueTree=flip_matrix, Delimiter=",")
custom_preview = CustomPreview(Geometry=lca_result_viewer.Geo, Material=create_material)
panel_2 = Panel(create_csv)
