# Grasshopper definition LCA_Toolbox_Karamba3d_Sample.gh (Grasshopper 1.0.7)
# plug-ins: Karamba3D

point_0_0_0 = Point(Point(0, 0, 0))
line_sdl = LineSDL(Start=point_0_0_0, Direction="1,0,0", Length=Slider(10, range=0..10))
divide_curve = DivideCurve(Curve=line_sdl, Count=Slider(8, range=2..10), Kinks=False)  # -> Points, Tangents, Parameters
dispatch = Dispatch(List=divide_curve.Points, DispatchPattern=invert([True, False]))  # -> ListA, ListB
unit_z = UnitZ(Factor=Slider(3, range=0..10))
geometry = Geometry(dispatch.ListA)
panel = Panel("""1
0""")
move = Move(Geometry=geometry, Motion=unit_z)  # -> Geometry, Transform
geometry_2 = Geometry(dispatch.ListB)
weave = Weave(Pattern=panel, Stream0=move.Geometry, Stream1=geometry_2, NullGaps=False)
end_points = EndPoints(Curve=line_sdl)  # -> Start, End
polyline = PolyLine(Vertices=geometry_2, Closed=False)
polyline_2 = PolyLine(Vertices=weave, Closed=False)
polyline_3 = PolyLine(Vertices=move.Geometry, Closed=False)
explode = Explode(Curve=polyline_3, Recursive=True)  # -> Segments, Vertices
explode_2 = Explode(Curve=polyline_2, Recursive=True)  # -> Segments, Vertices
explode_3 = Explode(Curve=polyline, Recursive=True)  # -> Segments, Vertices
support_point_start = Point(end_points.Start)
support_point_end = Point(end_points.End)

material_selection_karamba3d = MaterialSelectionKaramba3D(menu=[dropdown(1), dropdown(2)])
material_selection_karamba3d_2 = MaterialSelectionKaramba3D(menu=[dropdown(2), dropdown(1)])

unit_z_2 = UnitZ(Factor="-300")
line_to_beam_karamba3d = LineToBeamKaramba3D(
    Line=explode.Segments,
    Identifier="UpperMember",
    New=True,
    Remove=True,
    LimitDistance_m=0.005,
    Bending=True,
    SetBucklingLength=True,
    ToPolylineMaxAngle=0.03,
    ToPolylineTolerance=0.01,
    ToPolylineMaxEdgeLength=0.25)  # -> Element, Points, Info
line_to_beam_karamba3d_2 = LineToBeamKaramba3D(
    Line=explode_2.Segments,
    Identifier="WEB",
    New=True,
    Remove=True,
    LimitDistance_m=0.005,
    Bending=True,
    SetBucklingLength=True,
    ToPolylineMaxAngle=0.03,
    ToPolylineTolerance=0.01,
    ToPolylineMaxEdgeLength=0.25)  # -> Element, Points, Info
support_karamba3d = SupportKaramba3D(PosInd=support_point_end, menu=[buttons(off, on, on, on, off, on)])
line_to_beam_karamba3d_3 = LineToBeamKaramba3D(
    Line=explode_3.Segments,
    Identifier="LowerMember",
    New=True,
    Remove=True,
    LimitDistance_m=0.005,
    Bending=True,
    SetBucklingLength=True,
    ToPolylineMaxAngle=0.03,
    ToPolylineTolerance=0.01,
    ToPolylineMaxEdgeLength=0.25)  # -> Element, Points, Info
support_karamba3d_2 = SupportKaramba3D(PosInd=support_point_start, menu=[buttons(on, on, on, on, on, on)])
loads_karamba3d = LoadsKaramba3D(ForceVector=unit_z_2, Local=False, PosInd=explode_3.Vertices, LCase="LC0", mode="Point")
loads_karamba3d_2 = LoadsKaramba3D(Vector=Vector(0, 0, -1), LCase="LC0", mode="Gravity")
merge = Merge(Data1=loads_karamba3d_2, Data2=loads_karamba3d)  # -> flatten(Result)
merge_2 = Merge(Data1=line_to_beam_karamba3d.Element, Data2=line_to_beam_karamba3d_2.Element, Data3=line_to_beam_karamba3d_3.Element)  # -> flatten(Result)
merge_3 = Merge(Data1=support_karamba3d_2, Data2=support_karamba3d)

range = Range(Domain="1 to 20", Steps=10)
range_2 = Range(Domain="1 to 30", Steps=10)
panel_2 = Panel("10")
cross_section_karamba3d = CrossSectionKaramba3D(
    FamilyNameOfCrossSection="DefaultCroSec",
    Material=material_selection_karamba3d,
    Height_cm=range,
    UpperFlangeWidth_cm=range,
    LowerFlangeWidth_cm=range,
    mode="Trapezoid")
cross_section_karamba3d_2 = CrossSectionKaramba3D(
    FamilyNameOfCrossSection="DefaultCroSec",
    Material=material_selection_karamba3d_2,
    Height_cm=range,
    UpperFlangeWidth_cm=range,
    LowerFlangeWidth_cm=range,
    mode="Trapezoid")
merge_4 = Merge(Data1=cross_section_karamba3d_2, Data2=cross_section_karamba3d)  # -> flatten(Result)
assemble_model_karamba3d = AssembleModelKaramba3D(Elem=merge_2, Support=merge_3, Load=merge, CrossSection=cross_section_karamba3d, LimitDistance_m=0.005)  # -> Model, Info, Mass_kg, CentreOfGravity, LoadCaseNames
optimize_cross_section_karamba3d = OptimizeCrossSectionKaramba3D(
    Model=assemble_model_karamba3d.Model,
    CrossSections=merge_4,
    MaximumUtilization=Slider(0.6, range=0..1),
    UltimateLimitStateIterations=5,
    DisplacementIterations=5,
    NumberOfSamplePoints=3,
    ElasticDesign=True,
    GammaM0=1,
    GammaM1=1.1,
    SwayFrame=True)  # -> OptimizedModel, Info, Mass_kg, MaximumDisplacement_cm, ElasticEnergyChange_kNm, MaximumDisplacementViewLimitCrossSections, MaximumUtilizationViewInsufficientCrossSections
model_view_karamba3d = ModelViewKaramba3D(Model=optimize_cross_section_karamba3d.OptimizedModel)  # -> Model, DeformedMesh, DeformedAxes, DeformedModel, MaximumDeformation
beam_view_karamba3d = BeamViewKaramba3D(Model=model_view_karamba3d.Model)  # -> Model, MeshesOfRenderedBeams, DeformedBeamAxes, LegendColours, LegendTags
legend = Legend(Colour=beam_view_karamba3d.LegendColours, Tags=beam_view_karamba3d.LegendTags, LegendType=1)
