# Grasshopper definition LAC_Samplefile.gh (Grasshopper 1.0.7)
# plug-ins: GH_LCA

material_name = ValueList({"Aluminium sheet", "Aluminium frame window", "Concrete C20/25", "Concrete C30/37", "Concrete roof tiles", "Unfired clay brick", "Oak tree", "EPS insulation Graphite 80", "Gypsum fibre board (paper)", "Cement-bonded particle board"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}, selected="Concrete C30/37")

# ----
# 01
# Construct and deconstruct materials
# connect "value list" to auto populate the list
panel = Panel("Test material")
lac_construct_material_from_materialpyra = LACConstructMaterialFromMaterialpyramidenDk(MaterialName=material_name, A4_CO2eq_kg="100", C_CO2eq_kg="200", D_CO2eq_kg="300")  # -> Material, Name, Density_kg_m3, GWP_kg_CO2eq_m3
lca_construct_material = LCAConstructMaterial(Name=panel, MaterialGroup="unknown group", Density_kg_m3="300", GWP_kg_CO2eq_m3="500")
lca_deconstruct_material = LCADeconstructMaterial(Material=lca_construct_material)  # -> Name, Category, MaterialGUID, Description, Density, Insulation, GWP, ODP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
lca_deconstruct_material_2 = LCADeconstructMaterial(Material=lac_construct_material_from_materialpyra.Material)  # -> Name, Category, MaterialGUID, Description, Density, Insulation, GWP, ODP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
panel_2 = Panel([lca_deconstruct_material.Name, lca_deconstruct_material.Category, lca_deconstruct_material.MaterialGUID, lca_deconstruct_material.Description, lca_deconstruct_material.Density, lca_deconstruct_material.Insulation, lca_deconstruct_material.GWP, lca_deconstruct_material.ODP, lca_deconstruct_material.POCP, lca_deconstruct_material.EP, lca_deconstruct_material.AP, lca_deconstruct_material.A4, lca_deconstruct_material.C, lca_deconstruct_material.D, lca_deconstruct_material.DataSource])
panel_3 = Panel([lca_deconstruct_material_2.Name, lca_deconstruct_material_2.Category, lca_deconstruct_material_2.MaterialGUID, lca_deconstruct_material_2.Description, lca_deconstruct_material_2.Density, lca_deconstruct_material_2.Insulation, lca_deconstruct_material_2.GWP, lca_deconstruct_material_2.ODP, lca_deconstruct_material_2.POCP, lca_deconstruct_material_2.EP, lca_deconstruct_material_2.AP, lca_deconstruct_material_2.A4, lca_deconstruct_material_2.C, lca_deconstruct_material_2.D, lca_deconstruct_material_2.DataSource])
panel_4 = Panel(lac_construct_material_from_materialpyra.Material)

# ----
# 02
# Combine geometry and materials into elements.
# 1m³ box
geometry = Geometry({Plane=PlaneXY(0, 0, 0), X=Domain(0, 1000), Y=Domain(0, 1000), Z=Domain(0, 1000)})

# ----
# 1m curve
curve = Curve(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)

# ----
# from a curve
panel_5 = Panel("200")
lca_create_element_from_curve = LCACreateElementFromCurve(
    Curve=curve,
    Material=lac_construct_material_from_materialpyra.Material,
    CrossSectionArea_Rhino_Units_2=panel_5,
    ExpectedLifetime_years="50")  # -> Element, Volume_m3, Weight_kg, GWPA1A3_kg_CO2eq

# ----
# 1m² surface
surface = Surface(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)

# ----
# from a surface
panel_6 = Panel("10")
lca_create_element_from_surface = LCACreateElementFromSurface(Surface=surface, Material=lca_construct_material, Thickness_Rhino_Units_2=panel_6, ExpectedLifetime_years="100")  # -> Element, Volume_m3, Weight_kg, GWPA1A3_kg_CO2eq

# ----
# from a sold
lca_create_element_from_solid = LCACreateElementFromSolid(
    Geometry=geometry,
    Material=lac_construct_material_from_materialpyra.Material,
    ExpectedLifetime_years="10",
    ElementGroup="Boxes")  # -> Element, Volume_m3, Weight_kg, GWP_kg_CO2eq

# ----
# 03
# assemble elements into a model
merge = Merge(
    Data1=lca_create_element_from_solid.Element,
    Data2=lca_create_element_from_curve.Element,
    Data3=lca_create_element_from_surface.Element)
lca_assemble_model = LCAAssembleModel(Elements=merge, CalculatedBuildingLifetime_years="60")  # -> Model, ListNamesByMaterial, SUMGWP_kg_CO2eq, ListGWPKgCO2eqByMaterial, ListGWPByMaterial, SUMWeight_kg, ListWeightKgByMaterial, ListWeightByMaterial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
panel_7 = Panel(lca_assemble_model.ListNamesByMaterial)
panel_8 = Panel(lca_assemble_model.ListGWPKgCO2eqByMaterial)

# ----
# 04
# ANALYSE AND FILTER MODEL
# 
# UNDER DEVELOMPENT
lca_results_by_element = LCAResultsByElement()
